# Grasshopper definition Revit_All_to_Rhino.gh (Grasshopper 1.0.7)
# plug-ins: Rhino.Inside for Autodesk Revit

active_graphical_view = ActiveGraphicalView()
selectable_in_view_filter = SelectableInViewFilter(View=active_graphical_view, Inverted=False)
query_elements = QueryElements(Filter=selectable_in_view_filter)  # -> Elements, Count
element_geometry = ElementGeometry(Elements=query_elements.Elements)
